# Grasshopper definition 2Rm_VAVReheat.gh (Grasshopper 0.9.76)
# plug-ins: Python Interpreter, Ironbug

# Two rooms with VAV Reheat system
ladybug = Ladybug_Ladybug()  # -> Vviiiiiiiiiizzz; plug-in component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
brep = Brep([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])
mass2zone = Honeybee_Masses2Zones(zoneMasses=flatten(brep), maxRoofAngle=30, createHBZones=Toggle(True))  # -> readMe, HBZones; plug-in component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
honeybee = Honeybee_Honeybee()  # -> Vviiiiiiiiiizzz; plug-in component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
coilhw = Ironbug_CoilHeatingWater()
panel = Panel(mass2zone.HBZones)
lng = ListLength(List=mass2zone.HBZones)
puppets = Ironbug_CreatePuppets(Reference=coilhw, Amount=lng)
# Double check the temperature
number_slider = Slider(50, range=0..100)
vavreheat = Ironbug_AirTerminalSingleDuctVAVReheat(HeatingCoil=puppets)
graft = GraftTree(Tree=puppets, IncludeEmptyLists=True, IncludeNullItems=True)
pumpvariable = Ironbug_PumpVariableSpeed()
boilerhw = Ironbug_BoilerHotWater()
boilerhw_2 = Ironbug_BoilerHotWater()
pumpvariable_2 = Ironbug_PumpVariableSpeed()
thermalzone = Ironbug_ThermalZone(HoneybeeZone=mass2zone.HBZones, AirTerminal_=vavreheat)
chillere = Ironbug_ChillerElectricEIR()
clntower1 = Ironbug_CoolingTowerSingleSpeed()
pumpconstant = Ironbug_PumpConstantSpeed()
pumpvariable_3 = Ironbug_PumpVariableSpeed()
spoareset = Ironbug_SetpointManagerOutdoorAirReset(
    SetpointatOutdoorHighTemperature=number_slider,
    OutdoorHighTemperature=Slider(30, range=0..100),
    SetpointatOutdoorLowTemperature=Slider(80, range=0..100),
    OutdoorLowTemperature=Slider(10, range=0..10))
nickname = Ironbug_OutdoorAirSystem()
coilhw_2 = Ironbug_CoilHeatingWater()
coilcw = Ironbug_CoilCoolingWater()
branches = PlantBranches(B1=[boilerhw, pumpvariable_2], B2=[boilerhw_2, pumpvariable])
fanvariable = Ironbug_FanVariableVolume()
branches_2 = PlantBranches(Branch1=[chillere, pumpconstant])
branches_3 = PlantBranches(Branch1=clntower1)
branches_4 = PlantBranches(B1=graft, B2=coilhw_2)
branches_5 = PlantBranches(Branch1=chillere)
branches_6 = AirLoopBranches(Branch1=thermalzone)
branches_7 = PlantBranches(Branch1=coilcw)
# Air loop
airloop = Ironbug_AirLoopHVAC(Supply=[nickname, coilcw, coilhw_2, fanvariable], Demand=branches_6)
# Hot water loop
hwloop = Ironbug_HotWaterPlantLoop(Supply=[branches, spoareset], Demand=branches_4)
# Condenser water loop
dwloop = Ironbug_CondenserWaterPlantLoop(Supply=[pumpvariable_3, branches_3], Demand=branches_5)
# Chilled water loop
cwloop = Ironbug_ChilledWaterPlantLoop(Supply=branches_2, Demand=branches_7)
nickname_2 = Ironbug_SaveOSModel(AirLoops=flatten(airloop), PlantLoops=flatten([cwloop, dwloop, hwloop]), _write=Toggle(False))
panel_2 = Panel(nickname_2)
