# Grasshopper definition 01_pgn.gh (Grasshopper 0.9.76)
# plug-ins: Archsim, Ironbug

number_slider = Slider(0.7, range=0..1)
panel = Panel("C:\Users\Mingbo\Documents\GitHub\HoneybeeCSharp\doc\testFile\X_4.png")
panel_2 = Panel("C:\Users\Mingbo\Documents\GitHub\HoneybeeCSharp\doc\testFile\AcceleRad_test_IMG_Perspective_CPU@fc.TIF")
panel_3 = Panel("C:\Users\Mingbo\Documents\GitHub\HoneybeeCSharp\doc\testFile\indoor_view_h.HDR")
panel_4 = Panel("C:\Users\Mingbo\Documents\GitHub\HoneybeeCSharp\doc\testFile\AcceleRad_test_IMG_Perspective_GPU@fc.HDR")
viewdata = ViewData(Scale=1)  # -> imagePath, Value
array_schedule = ArraySchedule(Hours=[1, 1, 1, 1, 1, 1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])
rec = DataRecorder(DataLimit=-10, RecordData=True)
panel_5 = Panel(rec)
clean = CleanTree(RemoveNulls=True, RemoveInvalid=True, RemoveEmpty=True, Tree=panel_5)
panel_6 = Panel(clean)
