# Grasshopper definition HVACSystemWorkflow.gh (Grasshopper 0.9.76)
# plug-ins: Python Interpreter, Ironbug.Grasshopper

coilhtngas = Ironbug_CoilHeatingGas()
brep = Brep([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])
brep_2 = Brep()
honeybee = Honeybee_Honeybee()  # -> Vviiiiiiiiiizzz; plug-in component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
ladybug = Ladybug_Ladybug()  # -> Vviiiiiiiiiizzz; plug-in component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
intersectmass = IntersectMass(x=brep)  # -> out, A; inputs x: list of Brep
# ---------- intersectmass: C# ----------
    var tolerance = Rhino.RhinoDoc.ActiveDoc.ModelAbsoluteTolerance;
    List<Brep> allOldBreps = x;

    if (x.Count() > 0)
    {
      var results = allOldBreps.AsParallel().AsOrdered().Select(b => SplitBrepWithBreps(b, allOldBreps, tolerance));
      A = results;
    }

    //SplitBrepWithBreps(x[0], x, tolerance);
# ---------- intersectmass: C# additional code ----------
  static Brep SplitBrepWithBreps(Brep CurrentBrep, List<Brep> AllBreps, double tolerance)
  {
    var currentBrep = CurrentBrep;
    var allBreps = AllBreps;

    foreach (Brep item in allBreps)
    {
      var  tempBrep = currentBrep.Split(item, tolerance);
      if (tempBrep.Count() > 0)
      {
        var newBrep = Rhino.Geometry.Brep.JoinBreps(tempBrep, tolerance);

        currentBrep = newBrep.First();
        currentBrep.Faces.ShrinkFaces();
      }
    }
    return currentBrep;

  }
# ---------- end intersectmass ----------
number_slider = Slider(0.7, range=0..1)
mass2zone = Honeybee_Masses2Zones(zoneMasses=flatten(intersectmass.A), maxRoofAngle=30, createHBZones=Toggle(True))  # -> readMe, HBZones; plug-in component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

# ----
# FourPipeFanCoil
panel = Panel("0.5")
coilhw = Ironbug_CoilHeatingWater()  # -> AirSide_CoilHeatingWater, WaterSide_CoilHeatingWater
coilclnwater = Ironbug_CoilCoolingWater()  # -> AirSide_CoilCoolingWater, WaterSide_CoilCoolingWater
lng = ListLength(List=brep_2)
objparams = Ironbug_ObjParams(FanEfficiency=panel, MotorEfficiency="0.9", PressureRise="75", DataFieldSetType="Ironbug.HVAC.IB_FanOnOff_DataFields")
panel_2 = Panel(lng)
objparams_2 = Ironbug_ObjParams(MaximumOutdoorAirFlowRate="0", DataFieldSetType="Ironbug.HVAC.IB_ZoneHVACFourPipeFanCoil_DataFieldSet")
duplicate = Ironbug_Duplicate(Reference=coilclnwater.AirSide_CoilCoolingWater, Amount=panel_2)  # -> Objects, graft(WaterSide_CoilCoolingWater)
duplicate_2 = Ironbug_Duplicate(Reference=coilhw.AirSide_CoilHeatingWater, Amount=panel_2)  # -> Objects, graft(WaterSide_CoilHeatingWater)
fanonoff = Ironbug_FanOnOff(Parameters_=objparams)
_4pipefancoil = Ironbug_ZoneHVACFourPipeFanCoil(HeatingCoil=duplicate_2.Objects, CoolingCoil=duplicate.Objects, Fan_=fanonoff, Parameters_=objparams_2)

panel_3 = Panel("https://www.energyplus.net/weather-download/north_and_central_america_wmo_region_4/USA/NY/USA_NY_New.York-LaGuardia.AP.725030_TMY3/all")
glzparamlist = Honeybee_GlazingParametersList(northGlzParam=0, westGlzParam=0, southGlzParam=number_slider, eastGlzParam=number_slider)  # -> glzParamList; plug-in component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
panel_4 = Panel("DifferentialDryBulb")
solveadjc = Honeybee_SolveAdjacencies(HBZones=flatten(mass2zone.HBZones), removeCurrentAdjc=False, findAdjc=Toggle(True))  # -> readMe, HBZonesWADJ; plug-in component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
glazingcreator = Honeybee_GlazingBasedOnRatio(HBObjects=solveadjc.HBZonesWADJ, glzRatio=glzparamlist, runIt=Toggle(True))  # -> readMe, HBObjWGLZ; plug-in component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
data = Data(flatten(glazingcreator.HBObjWGLZ))
epw_stat = Ladybug_OpenEPWAndSTATWeatherFiles(weatherFileURL=panel_3)  # -> epwFile, statFile; plug-in component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

# ----
# Sys11_Fan Coil Units + DOAS
# Airloop
panel_5 = Panel("VentilationRequirement")
objparams_3 = Ironbug_ObjParams(FanEfficiency="0.6", PressureRise="500", DataFieldSetType="Ironbug.HVAC.IB_FanConstantVolume_DataFields")
heatexchanger_air = Ironbug_HeatExchangerAirToAirSensibleAndLatent()
objparams_4 = Ironbug_ObjParams(
    AllOutdoorAirinCooling=Toggle(True),
    AllOutdoorAirinHeating=Toggle(True),
    CentralHeatingDesignSupplyAirTemperature="40",
    MinimumSystemAirFlowRatio="1",
    TypeofLoadtoSizeOn=panel_5,
    DataFieldSetType="Ironbug.HVAC.IB_SizingSystem_FieldSet")
oasystem = Ironbug_OutdoorAirSystem(HeatRecovery_=heatexchanger_air)
coilcw = Ironbug_CoilCoolingWater()  # -> AirSide_CoilCoolingWater, WaterSide_CoilCoolingWater
coilhw_2 = Ironbug_CoilHeatingWater()  # -> AirSide_CoilHeatingWater, WaterSide_CoilHeatingWater
thermalzone = Ironbug_ThermalZone(HoneybeeZone=brep_2, ZoneEquipments=_4pipefancoil, IsAirTerminalPriorToZoneEquipments=True)
spscheduled = Ironbug_SetpointManagerScheduled(Temperature="20")
fanconstant = Ironbug_FanConstantVolume(Parameters_=objparams_3)
szsystem = Ironbug_SizingSystem(Parameters=objparams_4)
branches = AirLoopBranches(Branch1=thermalzone)
merge = Merge(
    Data1=oasystem,
    Data2=coilcw.AirSide_CoilCoolingWater,
    Data3=coilhw_2.AirSide_CoilHeatingWater,
    Data4=fanconstant,
    Data5=spscheduled)
airloop = Ironbug_AirLoopHVAC(Supply=merge, Demand=branches, SizingSystem=szsystem)

hvacsystemslist = Honeybee_HVACSystemsList({"-1. Thermostat Only": -1, "0. Ideal Air Loads": 0, "1. PTAC | Residential": 1, "2. PTHP | Residential": 2, "3. Packaged Single Zone - AC": 3, "4. Packaged Single Zone - HP": 4, "5. Packaged VAV w/ Reheat": 5, "6. Packaged VAV w/ PFP Boxes": 6, "7. VAV w/ Reheat": 7, "8. VAV w/ PFP Boxes": 8, "9. Warm Air Furnace - Gas Fired": 9, "10.Warm Air Furnace - Electric": 10, "11.Fan Coil Units + DOAS": 11, "12.Active Chilled Beams + DOAS": 12, "13.Radiant Floors + DOAS": 13, "14.Custom Rad Surfaces + DOAS": 14, "15.Heated Surfaces + VAV Cooling": 15, "16.VRF + DOAS": 16, "17.WSHP + DOAS": 17}, selected="11.Fan Coil Units + DOAS")

# ----
# Chilled water loop
panel_6 = Panel("0")
chiller_watercooled = Ironbug_ChillerElectricEIR_WaterCooled()  # -> ChillerElectricEIR, ChillerElectricEIR_CondenserLoop
objparams_5 = Ironbug_ObjParams(
    Coefficient1OfthePartLoadPerformanceCurve=panel_6,
    Coefficient2OfthePartLoadPerformanceCurve="0.0216",
    Coefficient3OfthePartLoadPerformanceCurve="-0.0325",
    Coefficient4OfthePartLoadPerformanceCurve="1.0095",
    RatedPumpHead="119563",
    DataFieldSetType="Ironbug.HVAC.IB_PumpVariableSpeed_DataFields")
objparams_6 = Ironbug_ObjParams(
    DesignLoopExitTemperature="6.7",
    LoopDesignTemperatureDifference="6.7",
    DataFieldSetType="Ironbug.HVAC.IB_SizingPlant_DataFieldSet")
objparams_7 = Ironbug_ObjParams(MaximumLoopTemperature="98", DataFieldSetType="Ironbug.HVAC.IB_PlantLoop_DataFieldSet")
szplant = Ironbug_SizingPlant(Parameters_=objparams_6)
spscheduled_2 = Ironbug_SetpointManagerScheduled(Temperature="6.7")
pumpvariable = Ironbug_PumpVariableSpeed(Parameters=objparams_5)
branches_2 = PlantBranches(Branch1=chiller_watercooled.ChillerElectricEIR)
branches_3 = PlantBranches(Branch1=coilcw.WaterSide_CoilCoolingWater, Branch=duplicate.WaterSide_CoilCoolingWater)
cwloop = Ironbug_ChilledWaterPlantLoop(Supply=[pumpvariable, branches_2, spscheduled_2], Demand=branches_3, SizingLoop=szplant, Parameters_=objparams_7)

# ----
# Hot water loop
panel_7 = Panel("0.0216")
objparams_8 = Ironbug_ObjParams(
    Coefficient1OfthePartLoadPerformanceCurve="0",
    Coefficient2OfthePartLoadPerformanceCurve=panel_7,
    Coefficient3OfthePartLoadPerformanceCurve="-0.0325",
    Coefficient4OfthePartLoadPerformanceCurve="1.0095",
    RatedPumpHead="119563",
    DataFieldSetType="Ironbug.HVAC.IB_PumpVariableSpeed_DataFields")
objparams_9 = Ironbug_ObjParams(NominalThermalEfficiency="0.9", DataFieldSetType="Ironbug.HVAC.IB_BoilerHotWater_DataFields")
boilerhw = Ironbug_BoilerHotWater(Parameters=objparams_9)
spscheduled_3 = Ironbug_SetpointManagerScheduled(Temperature="67")
pumpvariable_2 = Ironbug_PumpVariableSpeed(Parameters=objparams_8)
branches_4 = PlantBranches(Branch1=boilerhw)
branches_5 = PlantBranches(Branch1=duplicate_2.WaterSide_CoilHeatingWater, Branch=coilhw_2.WaterSide_CoilHeatingWater)
hwloop = Ironbug_HotWaterPlantLoop(Supply=[pumpvariable_2, branches_4, spscheduled_3], Demand=branches_5)

objparams_10 = Ironbug_ObjParams(
    Coefficient1OfthePartLoadPerformanceCurve="0",
    Coefficient2OfthePartLoadPerformanceCurve="0.0216",
    Coefficient3OfthePartLoadPerformanceCurve="-0.0325",
    Coefficient4OfthePartLoadPerformanceCurve="1.0095",
    RatedPumpHead="134508",
    DataFieldSetType="Ironbug.HVAC.IB_PumpVariableSpeed_DataFields")

# ----
# Condenser water loop
panel_8 = Panel("80")
pipeadiabatic = Ironbug_PipeAdiabatic()
coolingtowerv = Ironbug_CoolingTowerVariableSpeed()
objparams_11 = Ironbug_ObjParams(MaximumLoopTemperature=panel_8, MinimumLoopTemperature="5", DataFieldSetType="Ironbug.HVAC.IB_PlantLoop_DataFieldSet")
spfollowoatemp = Ironbug_SetpointManagerFollowOutdoorAirTemperature(MaximumSetpointTemperature="80", MinimumSetpointTemperature="5", OffsetTemperatureDifference="0")
pumpvariable_3 = Ironbug_PumpVariableSpeed(Parameters=objparams_10)
branches_6 = PlantBranches(Branch1=coolingtowerv, Branch=pipeadiabatic)
branches_7 = PlantBranches(Branch1=chiller_watercooled.ChillerElectricEIR_CondenserLoop)
dwloop = Ironbug_CondenserWaterPlantLoop(Supply=[pumpvariable_3, branches_6, spfollowoatemp], Demand=branches_7, Parameters_=objparams_11)

hvacsystem = Honeybee_AssignHVACSystem(HBZones=glazingcreator.HBObjWGLZ, HVACSystems=hvacsystemslist)  # -> readMe, HBZones; plug-in component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
exporttoopenstudio = Honeybee_ExportToOpenStudio(epwWeatherFile=epw_stat.epwFile, HBZones=flatten(hvacsystem.HBZones), writeOSM=Toggle(False), fileName="HB_Sys")  # -> readMe, osmFileAddress, idfFileAddress, resultFileAddress, eioFileAddress, rddFileAddress, htmlReport, studyFolder, model; plug-in component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
merge_2 = Merge(Data1=hwloop, Data2=cwloop, Data3=dwloop)
hvacsystem_2 = Ironbug_HVACSystem(AirLoops=flatten(airloop), PlantLoops=flatten(merge_2))
exporttoopenstudio_2 = Honeybee_ExportToOpenStudio(
    epwWeatherFile=epw_stat.epwFile,
    HBZones=flatten(glazingcreator.HBObjWGLZ),
    HVACSystem=flatten(hvacsystem_2),
    writeOSM=Toggle(False),
    fileName="IB_Sys")  # -> readMe, osmFileAddress, idfFileAddress, resultFileAddress, eioFileAddress, rddFileAddress, htmlReport, studyFolder, model; plug-in component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
readepresult = Honeybee_ReadEPResult(resultFileAddress=exporttoopenstudio.resultFileAddress)  # -> totalThermalLoad, thermalLoadBalance, cooling, heating, electricLight, electricEquip, fanElectric, pumpElectric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; plug-in component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
panel_9 = Panel(exporttoopenstudio.osmFileAddress)
c_script = CSharpScript(x=exporttoopenstudio_2.osmFileAddress, Reference="C:\openstudio-2.5.0\CSharp\openstudio\OpenStudio.dll")  # -> out, A; inputs x: String; disabled
# ---------- c_script: C# ----------
    if (!string.IsNullOrEmpty(x))
    {
      var p = new OpenStudio.Path(x);
      var m = OpenStudio.Model.load(p).get();
      var plantLps = m.getPlantLoops();
      foreach (OpenStudio.PlantLoop pl in plantLps)
      {
        
        var tp = pl.sizingPlant().loopType();
        Print(pl.nameString() + "_" + tp);
      }
    }
# ---------- end c_script ----------
readepresult_2 = Honeybee_ReadEPResult(resultFileAddress=exporttoopenstudio_2.resultFileAddress)  # -> totalThermalLoad, thermalLoadBalance, cooling, heating, electricLight, electricEquip, fanElectric, pumpElectric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; plug-in component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
panel_10 = Panel(exporttoopenstudio_2.osmFileAddress)
panel_11 = Panel(exporttoopenstudio.readMe)
strnum = Ladybug_SeparateData(inputList=flatten(readepresult.cooling))  # -> numbers, strings; plug-in component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
strnum_2 = Ladybug_SeparateData(inputList=flatten(readepresult.heating))  # -> numbers, strings; plug-in component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
strnum_3 = Ladybug_SeparateData(inputList=flatten(readepresult_2.cooling))  # -> numbers, strings; plug-in component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
strnum_4 = Ladybug_SeparateData(inputList=flatten(readepresult_2.heating))  # -> numbers, strings; plug-in component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
ma = MassAddition(Input=flatten(strnum.numbers))  # -> Result, PartialResults
ma_2 = MassAddition(Input=strnum_2.numbers)  # -> Result, PartialResults
# Airloop
hvacsystemslist_2 = Honeybee_HVACSystemsList({"-1. Thermostat Only": -1, "0. Ideal Air Loads": 0, "1. PTAC | Residential": 1, "2. PTHP | Residential": 2, "3. Packaged Single Zone - AC": 3, "4. Packaged Single Zone - HP": 4, "5. Packaged VAV w/ Reheat": 5, "6. Packaged VAV w/ PFP Boxes": 6, "7. VAV w/ Reheat": 7, "8. VAV w/ PFP Boxes": 8, "9. Warm Air Furnace - Gas Fired": 9, "10.Warm Air Furnace - Electric": 10, "11.Fan Coil Units + DOAS": 11, "12.Active Chilled Beams + DOAS": 12, "13.Radiant Floors + DOAS": 13, "14.Custom Rad Surfaces + DOAS": 14, "15.Heated Surfaces + VAV Cooling": 15, "16.VRF + DOAS": 16, "17.WSHP + DOAS": 17}, selected="13.Radiant Floors + DOAS")
ma_3 = MassAddition(Input=flatten(strnum_3.numbers))  # -> Result, PartialResults
ma_4 = MassAddition(Input=strnum_4.numbers)  # -> Result, PartialResults
panel_12 = Panel(ma_2.Result)
panel_13 = Panel(ma.Result)
panel_14 = Panel(ma_4.Result)
panel_15 = Panel(ma_3.Result)
hvactemplate = Ironbug_HVACTemplate()
timer = Timer(TimerInterval=1000)
list = ValueList({"One": 1, "Two": 2, "Three": 2² - 1, "Four": Sqrt(16)}, selected="One")
knob = ControlKnob(Decimals=2, Limit=True, Maximum=10, Minimum=0, Range=1, Value=1.03)
digit_scroller = DigitScroller(Scroller_Digits=12, Scroller_Radix=9, Scroller_Value=0.25)
item = CherryPicker(ListIndex=0)
gradient = Gradient(LowerLimit=0, UpperLimit=1, stops=[0.15: RGB(255, 130, 160), 0.85: RGB(220, 0, 40)])
dam = DataDam(BufferDelay=10000000, BufferMode=0)
nblur = BlurNumbers(Strength=0.5, Iterations=1, Lock=True, Wrap=False)
hvactemplate_2 = Ironbug_HVACTemplate(_run=Button())
list_2 = ValueList({"One": 1, "Two": 2, "Three": 2² - 1, "Four": Sqrt(16)}, selected="One")
